# Grasshopper definition ur5.ghx (Grasshopper 1.0.7)

reload = Button()

# ----
# Robot
load = Button()
python = PythonScript(load=load)  # -> robot
# ---------- python: Python ----------
from scriptcontext import sticky as st

import compas

from compas.robots import RobotModel
from compas.robots import GithubPackageMeshLoader
from compas_fab.robots.ur5 import Robot
from compas_ghpython.artists import RobotModelArtist

# Robot meshes are usually in meters
# Set a high precision to prevent parsing errors
# and configure Rhino itself in meters
compas.PRECISION = '12f'

# Store robot in component-based key
robot_key = 'robot_{}'.format(str(ghenv.Component.InstanceGuid))

if robot_key not in st:
    st[robot_key] = None

if load:
    robot = Robot(load_geometry=True)    
    robot.artist = RobotModelArtist(robot.model)

    st[robot_key] = robot

robot = st[robot_key]
# ---------- end python ----------
robot = Data(python)

py = PythonScript(reload=reload)
# ---------- py: Python ----------
if reload:
    from compas_ghpython import unload_modules
    unload_modules('compas')
# ---------- end py ----------

# ---- group: forward kinematics
# Configuration
a1 = Slider(0, range=-360..360)
a2 = Slider(0, range=-360..360)
a3 = Slider(0, range=-360..360)
a4 = Slider(0, range=-360..360)
a5 = Slider(0, range=-360..360)
a6 = Slider(0, range=-360..360)
forward_kinematics = PythonScript(robot=robot, a1=a1, a2=a2, a3=a3, a4=a4, a5=a5, a6=a6)  # -> configuration
# ---------- forward_kinematics: Python ----------
import math
from compas_fab.robots import Configuration

if robot:
    joint_values = [a1, a2, a3, a4, a5, a6]
    joint_names = robot.get_configurable_joint_names()
    configuration = Configuration.from_revolute_values([math.radians(a) for a in joint_values])
# ---------- end forward_kinematics ----------

# ----
# Plane
pt = Point(Point(-0.1214031389, -0.2684277754, 0.2835778565))
py_2 = GhPythonScript(pt=pt)  # -> pln
# ---------- py_2: Python ----------
import Rhino.Geometry as rg

pln = rg.Plane(rg.Point3d(-pt[0], -pt[1], pt[2]), -rg.Vector3d.ZAxis)
# ---------- end py_2 ----------
start_plane = Plane(py_2)
inverse_kinematics = GhPythonScript(plane=start_plane, index=Slider(0, range=0..7))  # -> config
# ---------- inverse_kinematics: Python ----------
import ur_kinematics
from compas.geometry import Frame
from compas_fab.robots import Configuration

frame = Frame([j * 1000 for j in plane.Origin], plane.XAxis, plane.YAxis)

ur5 = [89.159, -425.0, -392.25, 109.15, 94.65, 82.3]
solutions = ur_kinematics.inverse_kinematics(frame, ur5)
config = Configuration.from_revolute_values(solutions[int(index)])
print config
# ---------- end inverse_kinematics ----------

list = ValueList({"0 forward kinematics": 0, "1 inverse kinematics": 1}, selected="1 inverse kinematics")

# ----
# Visualisation
filter = StreamFilter(Gate=list, Stream0=forward_kinematics, Stream1=inverse_kinematics)
show_end_effector_frame = BooleanToggle(False)
show_base_frame = BooleanToggle(False)
show_collision = BooleanToggle(False)
show_frames = BooleanToggle(False)
show_visual = BooleanToggle(True)
visualize = PythonScript(
    robot=robot,
    configuration=filter,
    show_visual=show_visual,
    show_collision=show_collision,
    show_frames=show_frames,
    show_base_frame=show_base_frame,
    show_end_effector_frame=show_end_effector_frame)  # -> visual, collision, frames, ee_frame, base_frame
# ---------- visualize: Python ----------
"""Visualizes a robot.
    Inputs:
        robot: The robot
        configuration: :class:`compas_fab.robots.Configuration`
            The robot's full configuration to display.
        show_visual: bool
           Whether or not to show the robot's visual meshes.
        show_collision: bool
           Whether or not to show the robot's collision meshes.
        show_frames: bool
           Whether or not to show the robot's joint frames.
        show_base_frame: bool
           Whether or not to show the robot's base frame.
        show_end_effector_frame: bool
            Whether or not to show the robot's end-effector frame.
    Output:
        visual: The robot's visual meshes.
        collision: The robot's collision meshes.
        frames: The robot's joint frames.
        base_frame: The robot's base frame.
        ee_frame: The robot's end-effector frame.
"""
from __future__ import print_function

if robot and configuration:
    group = 'manipulator'

    robot.update(configuration, group, visual=show_visual, collision=show_collision)

    if show_visual:
        visual = robot.artist.draw_visual()

    if show_collision:
        collision = robot.artist.draw_collision()

    if show_frames:
        axes = robot.transformed_axes(configuration, group)
        frames = robot.transformed_frames(configuration, group)

    if show_base_frame:
        frames = robot.transformed_frames(configuration, group)
        base_frame = frames[0]

    if show_end_effector_frame:
        ee_frame = robot.forward_kinematics(configuration, group)
        print("End-effector", ee_frame)
# ---------- end visualize ----------
geo = Geometry(visualize.collision)
geo_2 = Geometry(visualize.visual)
